# Grasshopper definition RobotCell.gh (Grasshopper 1.0.8)
# plug-ins: eleFront

env_colli_geometry = Geometry([<mesh referenced from the Rhino model> x12])
get_rhino_attributes = GetRhinoAttributes(Geometry=env_colli_geometry, fullpath=False)  # -> Name, Layer, Color, MaterialName, SourceFile
tool_colli_geometry = Geometry([<mesh referenced from the Rhino model> x3])
geometry = Geometry([<mesh referenced from the Rhino model> x14])  # disabled
geometry_2 = Geometry(<mesh referenced from the Rhino model>)  # disabled
ur10e_robotcell = Python3Script(collision_env=geometry, tool=geometry_2)  # -> out, robot; inputs collision_env: list of Mesh; disabled
# ---------- ur10e_robotcell: Python ----------
from compas_fab.robots import RobotCellLibrary, RigidBody
from compas_robots import ToolModel
from compas_fab.robots import RobotCell, RobotCellState
from compas_rhino.conversions import mesh_to_compas  


robot_cell, robot_cell_state = RobotCellLibrary.ur10e()

for i, rhino_mesh in enumerate(collision_env):
    mesh = mesh_to_compas(rhino_mesh)
    robot_cell.rigid_body_models[i] = RigidBody.from_mesh(mesh)
# ---------- end ur10e_robotcell ----------
rigid_body = Python3Script(name=get_rhino_attributes.Name, visual=env_colli_geometry, collision=env_colli_geometry)  # -> out, rigid_body; inputs visual: Mesh, collision: Mesh
# ---------- rigid_body: Python ----------
# venv: compas_fab_dev

from compas_fab.robots import RigidBody

from compas_rhino.conversions import mesh_to_compas

box_visuals= []
box_collisions = []
box_visuals.append(mesh_to_compas(visual))
box_collisions.append(mesh_to_compas(collision))

rigid_body = RigidBody(box_visuals,box_collisions,native_scale = 0.001)
if name:
    rigid_body.name = name
# ---------- end rigid_body ----------
tool_model = Python3Script(name="Bucket", visual=tool_colli_geometry, collision=tool_colli_geometry)  # -> out, tool_model; inputs visual: list of Mesh, collision: list of Mesh
# ---------- tool_model: Python ----------
# venv: compas_fab_dev

from compas_robots import RobotModel, ToolModel
# from compas_fab import 
from compas.geometry import Frame
from compas_rhino.conversions import mesh_to_compas

visuals= [mesh_to_compas(m) for m in visual]
collisions = [mesh_to_compas(m) for m in collision]
# visuals.append(mesh_to_compas(visual))
# collisions.append(mesh_to_compas(collision))
for m in visuals:
    m.scale(0.001) 

for m in collisions:
    m.scale(0.001) 

tool_frame = Frame([0, 0, 0], [1, 0, 0], [0, 1, 0])
tool_model = ToolModel(visual=None, frame_in_tool0_frame=tool_frame, name=name)
tool_model.add_link("body", visual_meshes=visuals, collision_meshes=collisions)
# ---------- end tool_model ----------
load_compas_fab = Script(unload_module=Button())  # -> out, a
# ---------- load_compas_fab: Python ----------
# r: compas, compas_robots, roslibpy, scipy
# venv: compas_fab_dev

# import sys
# path_to_cf = r"C:\Users\Victor\Documents\GitHub\compas_fab\src"
# if path_to_cf not in sys.path:
#     sys.path.append(path_to_cf)

from compas_rhino import unload_modules

import scriptcontext as sc
if unload_module:
    print("Unload")
    unload_modules('compas')
    unload_modules('compas_fab')
    sc.sticky.clear()

import compas
print(compas.__file__)
print(compas.__version__)
import compas_fab
print(compas_fab.__file__)
print(compas_fab.__version__)

import sys
print(sys.path)
# ---------- end load_compas_fab ----------
static_gripper_small = Python3Script()  # -> out, tool_model
# ---------- static_gripper_small: Python ----------
from compas_fab.robots import ToolLibrary
tool_model = ToolLibrary.static_gripper_small()
# ---------- end static_gripper_small ----------
python_3_script = Python3Script(x=load_compas_fab.a, rigid_bodies=rigid_body.rigid_body, tool_models=tool_model.tool_model)  # -> out, robot_cell, robot_cell_state; inputs rigid_bodies: list, tool_models: list
# ---------- python_3_script: Python ----------
# venv: compas_fab_dev

from compas_fab.robots import RobotCell
from compas_fab.robots import RobotCellState
from compas_fab.robots import RigidBodyState
from compas.geometry import Box
from compas.geometry import Frame

from compas_fab.robots import RobotCellLibrary
robot_cell = RobotCell()
robot_cell, robot_cell_state = RobotCellLibrary.ur10e()

if (rigid_bodies):
    # Make sure RBs have unique names
    assert len(set([rb.name for rb in rigid_bodies])) == len(rigid_bodies)
    for rb in rigid_bodies:
        assert rb.name
        robot_cell.rigid_body_models[rb.name] = rb


if (tool_models):
    # Make sure RBs have unique names
    assert len(set([tool_model.name for tool_model in tool_models])) == len(tool_models)
    for tool_model in tool_models:
        assert tool_model.name
        robot_cell.tool_models[tool_model.name] = tool_model

robot_cell_state = robot_cell.default_cell_state()
touch_links = ["wrist_3_link"]
robot_cell_state.set_tool_attached_to_group(list(robot_cell.tool_models.keys())[0], robot_cell.main_group_name, touch_links=touch_links)


from compas.scene import Scene
scene = Scene()
scene.add(robot_cell)
# ---------- end python_3_script ----------
panel = Panel("C:\Users\Victor\Documents\GitHub\robot_game_collision_research\pybullet\robot_cell_and_state.json")
radians = Radians(Degrees=Slider(29.4, range=-180..180))
radians_2 = Radians(Degrees=Slider(8.77, range=-180..180))
radians_3 = Radians(Degrees=Slider(103.44, range=-180..180))
radians_4 = Radians(Degrees=Slider(28.3, range=-180..180))
radians_5 = Radians(Degrees=Slider(171.22, range=-180..180))
radians_6 = Radians(Degrees=Slider(160.99, range=-180..180))
json = Python3Script(path=panel, robot_cell=python_3_script.robot_cell, robot_cell_state=python_3_script.robot_cell_state)  # -> out, a
# ---------- json: Python ----------
import compas
robot_cell_and_state = {"robot_cell": robot_cell,
"robot_cell_state": robot_cell_state
}
compas.json_dump(robot_cell_and_state, path)
# ---------- end json ----------
robot_cell_state = Python3Script(
    robot_cell_state=python_3_script.robot_cell_state,
    j1=radians,
    j2=radians_2,
    j3=radians_3,
    j4=radians_4,
    j5=radians_5,
    j6=radians_6)  # -> out, new_robot_cell_state
# ---------- robot_cell_state: Python ----------
new_robot_cell_state = robot_cell_state.copy()
new_robot_cell_state.robot_configuration.joint_values[0] = j1
new_robot_cell_state.robot_configuration.joint_values[1] = j2
new_robot_cell_state.robot_configuration.joint_values[2] = j3
new_robot_cell_state.robot_configuration.joint_values[3] = j4
new_robot_cell_state.robot_configuration.joint_values[4] = j5
new_robot_cell_state.robot_configuration.joint_values[5] = j6
# ---------- end robot_cell_state ----------

visualization_scale = Slider(1, range=0..2)
python_3_script_2 = Python3Script(draw_collision=Toggle(False), draw_visual=Toggle(True), scale=visualization_scale)  # -> out, options
# ---------- python_3_script_2: Python ----------
from compas.data import Data
class RobotCellVisualizationOptions(Data):
    def __init__(self, draw_collision, draw_visual, scale):
        super(RobotCellVisualizationOptions, self).__init__()
        self.draw_collision = draw_collision
        self.draw_visual = draw_visual
        self.scale = scale

    @property
    def __data__(self):
        data = {
            'draw_collision': self.draw_collision,
            'draw_visual': self.draw_visual,
            'scale': self.scale,
            }
        return data

options = RobotCellVisualizationOptions(draw_collision, draw_visual, scale)

print(options.sha256(True))
# ---------- end python_3_script_2 ----------

python_3_script_3 = Python3Script(
    x=python_3_script.out,
    obj=python_3_script.robot_cell,
    object_state=robot_cell_state.new_robot_cell_state,
    vis_options=python_3_script_2.options)  # -> out, draw
# ---------- python_3_script_3: Python ----------
# venv: compas_fab_dev

import scriptcontext as sc
from compas.scene import SceneObject
from compas.scene import Scene

from compas_ghpython import create_id

# This script will leak memory due to unused and untracked sceneobject in sticky

debug = True
def debug_print(s):
    if debug:
        print(s)

# Create hash (scope limited to this component) for cacheing SceneObject
# The Data.sha256 function includes the guid of the compas object
#object_hash = object.sha256(as_string=True)
# The ID function is much faster than the sha256()
object_hash = str(id(obj))
options_hash = vis_options.sha256(True)
# The ghenv.Component has a guid assigned by GH to each component instance
gh_component = ghenv.Component
sticky_id = create_id(gh_component, object_hash +"_"+ options_hash)
debug_print("Cacheing ID: '{}'".format(sticky_id))


# If scene object exist in sticky
scene_object = None
if sc.sticky.has_key(sticky_id):
    scene_object = sc.sticky[sticky_id]
    # Double check if the item is the same
    if scene_object.item is obj:
        debug_print("SceneObject '{}' reused for '{}'".format(type(scene_object).__name__, type(object).__name__))

# Create Scene Object
if scene_object is None:
    scene = Scene()
    kwargs = vis_options.__data__
    scene_object = scene.add(obj,native_scale = 0.001, **kwargs)
    debug_print("SceneObject {} newly created for {}".format(type(scene_object).__name__, type(object).__name__))
    sc.sticky[sticky_id] = scene_object

# print(scene_object._scale)
draw = scene_object.draw(object_state)
# ---------- end python_3_script_3 ----------
